# Dynamo graph Auto Dimension_Pipe V0.0.1.dyn "Auto Dimension_Pipe" (Dynamo 2.1.0.7500)

current = Document.Current()
activeView = Document.ActiveView(document=current)
categories = Categories("OST_PipeCurves")
all_elements_of_category = ElementsOfCategory(Category=categories)
categories_2 = Categories("OST_Grids")
all_elements_of_category_2 = ElementsOfCategory(Category=categories_2)
join = List.Join(list0=all_elements_of_category, list1=all_elements_of_category_2)
watch = Watch(join)
code_block = CodeBlock { 0; }
byCoordinates = Point.ByCoordinates(x=code_block, y=code_block, z=code_block)
YAxis = Vector.YAxis()
code_block_2 = CodeBlock { 500; }
byStartPointDirectionLength = Line.ByStartPointDirectionLength(startPoint=byCoordinates, direction=YAxis, length=code_block_2)
byElements = Dimension.ByElements(view=activeView, referenceElements=watch, line=byStartPointDirectionLength)
watch_2 = Watch(byElements)
getLocation = Element.GetLocation(element=all_elements_of_category)
watch_3 = Watch(getLocation)
startPoint = Curve.StartPoint(curve=watch_3)
endPoint = Curve.EndPoint(curve=watch_3)
byStartPointEndPoint = Line.ByStartPointEndPoint(startPoint=startPoint, endPoint=endPoint)
curve = Grid.Curve(grid=all_elements_of_category_2)
watch_4 = Watch(curve)
startPoint_2 = Curve.StartPoint(curve=watch_4)
endPoint_2 = Curve.EndPoint(curve=watch_4)
byStartPointEndPoint_2 = Line.ByStartPointEndPoint(startPoint=startPoint_2, endPoint=endPoint_2)
join_2 = List.Join(list0=byStartPointEndPoint, list1=byStartPointEndPoint_2)
watch_5 = Watch(join_2)
